# Dynamo graph 1. NIVELES.dyn (Dynamo 2.5.0.7460)

# group: PISOS
file_path = Filename("..\TAMBORADA.xlsx")
file_from_path = FileObject(path=file_path)
string = StringInput("nivel")
importExcel = Data.ImportExcel(file=file_from_path, sheetName=string)
restOfItems = List.RestOfItems(list=importExcel)
transpose = List.Transpose(lists=restOfItems)
code_block = CodeBlock(l=transpose) { l[1]; }
code_block_2 = CodeBlock(l=transpose) { l[0]; }
byElevationAndName = Level.ByElevationAndName(elevation=code_block, name=code_block_2)
