# Dynamo graph 2. ESTRUCTURA.dyn (Dynamo 2.13.1.3887)

code_block = CodeBlock { 15; }
byCenterPointRadius = Circle.ByCenterPointRadius(radius=code_block)
code_block_2 = CodeBlock { 6; }
regularPolygon = Polygon.RegularPolygon(circle=byCenterPointRadius, numberSides=code_block_2)
explode = Geometry.Explode(geometry=regularPolygon)
length = Curve.Length(curve=explode)
code_block_3 = CodeBlock { 2; }
pointsAtEqualChordLength = Curve.PointsAtEqualChordLength(curve=explode, divisions=code_block_3)
flatten = List.Flatten(list=pointsAtEqualChordLength)
points = Polygon.Points(polygon=regularPolygon)
join = List.Join(list0=flatten, list1=points)
asVector = Point.AsVector(point=join)
XAxis = Vector.XAxis()
ZAxis = Vector.ZAxis()
angleAboutAxis = Vector.AngleAboutAxis(otherVector=XAxis, rotationAxis=ZAxis)  # unwired: vector
sortByFunction = List.SortByFunction(list=asVector, sortFunction=angleAboutAxis)
asPoint = Vector.AsPoint(vector=sortByFunction)
boolean = BoolSelector(true)
byPoints = PolyCurve.ByPoints(points=asPoint, connectLastToFirst=boolean)
byCoordinates = Point.ByCoordinates()
code_block_4 = CodeBlock { 6; }
byCoordinates_2 = Point.ByCoordinates(z=code_block_4)
byOriginNormal = Plane.ByOriginNormal(origin=byCoordinates_2)
code_block_5 = CodeBlock { 20; }
byCenterPointRadius_2 = Circle.ByCenterPointRadius(radius=code_block_5)
code_block_6 = CodeBlock { 6; }
regularPolygon_2 = Polygon.RegularPolygon(circle=byCenterPointRadius_2, numberSides=code_block_6)
explode_2 = Geometry.Explode(geometry=regularPolygon_2)
length_2 = Curve.Length(curve=explode_2)
code_block_7 = CodeBlock { 2; }
pointsAtEqualChordLength_2 = Curve.PointsAtEqualChordLength(curve=explode_2, divisions=code_block_7)
flatten_2 = List.Flatten(list=pointsAtEqualChordLength_2)
points_2 = Polygon.Points(polygon=regularPolygon_2)
join_2 = List.Join(list0=flatten_2, list1=points_2)
asVector_2 = Point.AsVector(point=join_2)
XAxis_2 = Vector.XAxis()
ZAxis_2 = Vector.ZAxis()
angleAboutAxis_2 = Vector.AngleAboutAxis(otherVector=XAxis_2, rotationAxis=ZAxis_2)  # unwired: vector
sortByFunction_2 = List.SortByFunction(list=asVector_2, sortFunction=angleAboutAxis_2)
asPoint_2 = Vector.AsPoint(vector=sortByFunction_2)
boolean_2 = BoolSelector(true)
byPoints_2 = PolyCurve.ByPoints(points=asPoint_2, connectLastToFirst=boolean_2)
list_create = List.Create(item0=asPoint, item1=asPoint_2)
ZAxis_3 = Vector.ZAxis()
code_block_8 = CodeBlock { 6; }
translate = Geometry.Translate(geometry=list_create, direction=ZAxis_3, distance=code_block_8)
boolean_3 = BoolSelector(true)
byPoints_3 = PolyCurve.ByPoints(points=translate, connectLastToFirst=boolean_3)
ZAxis_4 = Vector.ZAxis()
code_block_9 = CodeBlock { -2; }
translate_2 = Geometry.Translate(direction=ZAxis_4, distance=code_block_9)  # unwired: geometry
