# Dynamo graph 01modelado tinglado estr.dyn (Dynamo 2.5.0.7460)

code_block = CodeBlock { x=[4.0511,4.3422,4.599,4.3767,2.1493,4.3757,4.59,4.3867,2.1753,4.3760,4.59,4.3767]; y=[0,0,0,0,0,0,0,0,0,0,0,0,0]; }

# group: coordenadas X
count = List.Count(list=code_block.x)
code_block_2 = CodeBlock(n=count) { 1..#n..1; }
takeItems = List.TakeItems(list=code_block.x, amount=code_block_2)
sum = Math.Sum(values=takeItems)

# group: coordenadas Y
count_2 = List.Count(list=code_block.y)
code_block_3 = CodeBlock(n=count_2) { 1..#n..1; }
takeItems_2 = List.TakeItems(list=code_block.y, amount=code_block_3)
sum_2 = Math.Sum(values=takeItems_2)

byCoordinates = Point.ByCoordinates(x=sum, y=sum_2, lacing=Longest)
YAxis = Vector.YAxis()
code_block_4 = CodeBlock { 22.50; }
translate = Geometry.Translate(geometry=byCoordinates, direction=YAxis, distance=code_block_4)
code_block_5 = CodeBlock(l=translate) { l[0]; l[3]; }
code_block_6 = CodeBlock(l=byCoordinates) { l[0]; l[3]; }

# group: puntos de extremos tinglado
list_create = List.Create(item0=code_block_5.out0, item1=code_block_6.out0)
list_create_2 = List.Create(item0=code_block_5.out0, item1=code_block_6.out0)
XAxis = Vector.XAxis()
code_block_7 = CodeBlock { -0.70; }
translate_2 = Geometry.Translate(geometry=list_create_2, direction=XAxis, distance=code_block_7)
list_create_3 = List.Create(item0=code_block_5.out1, item1=code_block_6.out1)
XAxis_2 = Vector.XAxis()
code_block_8 = CodeBlock { 0.70; }
translate_3 = Geometry.Translate(geometry=list_create_3, direction=XAxis_2, distance=code_block_8)

code_block_9 = CodeBlock(l=translate_2) { l[0]; l[1]; }
code_block_10 = CodeBlock(l=translate_3) { l[0]; l[1]; }
list_create_4 = List.Create(item0=code_block_9.out1, item1=code_block_10.out1)
ZAxis = Vector.ZAxis()
code_block_11 = CodeBlock { 4.65; }
translate_4 = Geometry.Translate(geometry=list_create_4, direction=ZAxis, distance=code_block_11)
code_block_12 = CodeBlock(l=translate_4) { l[0]; l[1]; }
byStartPointEndPoint = Line.ByStartPointEndPoint(startPoint=code_block_9.out1, endPoint=code_block_10.out1)
code_block_13 = CodeBlock { 0.5; }
pointAtParameter = Curve.PointAtParameter(curve=byStartPointEndPoint, param=code_block_13)
ZAxis_2 = Vector.ZAxis()
code_block_14 = CodeBlock { 7.22; }
translate_5 = Geometry.Translate(geometry=pointAtParameter, direction=ZAxis_2, distance=code_block_14)
list_create_5 = List.Create(item0=code_block_12.out0, item1=translate_5, item2=code_block_12.out1)
ZAxis_3 = Vector.ZAxis()
code_block_15 = CodeBlock { 0.66; }
translate_6 = Geometry.Translate(geometry=list_create_5, direction=ZAxis_3, distance=code_block_15)

# group: liston
byPoints = PolyCurve.ByPoints(points=list_create_5)
explode = Geometry.Explode(geometry=byPoints)
byPoints_2 = PolyCurve.ByPoints(points=translate_6)
explode_2 = Geometry.Explode(geometry=byPoints_2)

length = Curve.Length(curve=explode)
list_create_6 = List.Create(item0=explode, item1=explode_2)
length_2 = Curve.Length(curve=explode_2)
code_block_16 = CodeBlock { 0.80; }
div = length_2 / code_block_16
ceiling = Math.Ceiling(number=div)
code_block_17 = CodeBlock(n=ceiling) { 0..1..#n; }
pointAtParameter_2 = Curve.PointAtParameter(curve=list_create_6@L2, param=code_block_17)
flatten = List.Flatten(list=pointAtParameter_2@L3)
pruneDuplicates = Point.PruneDuplicates(points=flatten)

# group: montantes
code_block_18 = CodeBlock(l=pruneDuplicates) { l[0]; l[1]; }
byStartPointEndPoint_2 = Line.ByStartPointEndPoint(startPoint=code_block_18.out0, endPoint=code_block_18.out1)

code_block_19 = CodeBlock { 2; }
ofRepeatedItem = List.OfRepeatedItem(item=code_block_18.out0, amount=code_block_19)
code_block_20 = CodeBlock { [1,-1]; }

# group: iz a der
shiftIndices = List.ShiftIndices(list=code_block_18.out1, amount=code_block_20)
byStartPointEndPoint_3 = Line.ByStartPointEndPoint(startPoint=ofRepeatedItem, endPoint=shiftIndices)
dropItems = List.DropItems(list=byStartPointEndPoint_3, amount=code_block_20, lacing=Longest)

code_block_21 = CodeBlock { 2; [1,0]; }
dropEveryNthItem = List.DropEveryNthItem(list=dropItems, n=code_block_21.out0, offset=code_block_21.out1, lacing=Longest)
flatten_2 = List.Flatten(list=dropEveryNthItem)

# group: duplicar total
list_create_7 = List.Create(item0=byStartPointEndPoint_2, item1=flatten_2, item2=byPoints, item3=byPoints_2)
YAxis_2 = Vector.YAxis()
code_block_22 = CodeBlock { 0..#6..4.5; }
translate_7 = Geometry.Translate(geometry=list_create_7, direction=YAxis_2, distance=code_block_22@L1)

# group: travesaño
# note: montantes
firstItem = List.FirstItem(list=translate_7@L3)
code_block_23 = CodeBlock { 2; 0; }
dropEveryNthItem_2 = List.DropEveryNthItem(list=firstItem@L2, n=code_block_23.out0, offset=code_block_23.out1)
endPoint = Curve.EndPoint(curve=dropEveryNthItem_2)
transpose = List.Transpose(lists=endPoint)
byPoints_3 = PolyCurve.ByPoints(points=transpose)

code_block_24 = CodeBlock { [2,3]; }
getItemAtIndex = List.GetItemAtIndex(list=endPoint, index=code_block_24)
code_block_25 = CodeBlock { 1; }
shiftIndices_2 = List.ShiftIndices(list=getItemAtIndex@L2, amount=code_block_25)
reverse = List.Reverse(list=shiftIndices_2)
byStartPointEndPoint_4 = Line.ByStartPointEndPoint(startPoint=getItemAtIndex, endPoint=reverse)
dropItems_2 = List.DropItems(list=byStartPointEndPoint_4@L2, amount=code_block_25)
code_block_26 = CodeBlock { 3; }
getItemAtIndex_2 = List.GetItemAtIndex(list=translate_7@L3, index=code_block_26)
code_block_27 = CodeBlock { 2; }
# note: selecionar los travesaño
getItemAtIndex_3 = List.GetItemAtIndex(list=translate_7@L3, index=code_block_27)
list_create_8 = List.Create(item0=getItemAtIndex_2, item1=getItemAtIndex_3)
explode_3 = Geometry.Explode(geometry=list_create_8)

# group: material
flatten_3 = List.Flatten(list=explode_3)
levels = Levels("5 - Nivel Tercera Planta")
structural_framing_types = StructuralFramingTypes("C140")
beamByCurve = StructuralFraming.BeamByCurve(curve=flatten_3, level=levels, structuralFramingType=structural_framing_types)

# group: diagonales material
code_block_28 = CodeBlock { 1; }
getItemAtIndex_4 = List.GetItemAtIndex(list=translate_7@L3, index=code_block_28)
levels_2 = Levels("5 - Nivel Tercera Planta")
structural_framing_types_2 = StructuralFramingTypes("C140")
beamByCurve_2 = StructuralFraming.BeamByCurve(curve=getItemAtIndex_4, level=levels_2, structuralFramingType=structural_framing_types_2)
flatten_4 = List.Flatten(list=getItemAtIndex_4)

# group: material travesaño
flatten_5 = List.Flatten(list=firstItem)
levels_3 = Levels("5 - Nivel Tercera Planta")
structural_framing_types_3 = StructuralFramingTypes("C140")
beamByCurve_3 = StructuralFraming.BeamByCurve(curve=flatten_5, level=levels_3, structuralFramingType=structural_framing_types_3)

explode_4 = Geometry.Explode(geometry=byPoints_3)

# group: material travesaño
levels_4 = Levels("5 - Nivel Tercera Planta")
structural_framing_types_4 = StructuralFramingTypes("C140")
beamByCurve_4 = StructuralFraming.BeamByCurve(curve=explode_4, level=levels_4, structuralFramingType=structural_framing_types_4)

code_block_29 = CodeBlock { "Rotación de sección transversal"; }

# group: cambiar angulo travesaño
dropEveryNthItem_3 = List.DropEveryNthItem(list=code_block_17@L2, n=code_block_23.out0, offset=code_block_23.out1)
tangentAtParameter = Curve.TangentAtParameter(curve=explode_2, param=dropEveryNthItem_3)
flatten_6 = List.Flatten(list=tangentAtParameter)
XAxis_3 = Vector.XAxis()
YAxis_3 = Vector.YAxis()
angleAboutAxis = Vector.AngleAboutAxis(vector=flatten_6, otherVector=XAxis_3, rotationAxis=YAxis_3)

setParameterByName = Element.SetParameterByName(element=beamByCurve_4, parameterName=code_block_29, value=angleAboutAxis)
