# Dynamo graph Añadir partida para metraje.dyn (Dynamo 2.5.0.7460)
# packages: archi-lab.net 2016.12.7

createSharedParameterForAllCategories = Parameter.CreateSharedParameterForAllCategories()  # unwired: parameterName, groupName, type, group, instance
string = StringInput("Partida Nº 1")
string_2 = StringInput("Partida Nº 2")
string_3 = StringInput("Partida Nº 3")
string_4 = StringInput("Partida Nº 4")
string_5 = StringInput("Partida Nº 5")
string_6 = StringInput("Unidad Nº 1")
string_7 = StringInput("Unidad Nº 2")
string_8 = StringInput("Unidad Nº 3")
string_9 = StringInput("Unidad Nº 4")
string_10 = StringInput("Eje")
string_11 = StringInput("Ubicacion")
list_create = List.Create(item0=string, item1=string_2, item2=string_3, item3=string_4, item4=string_5, item5=string_6, item6=string_7, item7=string_8, item8=string_9, item9=string_10, item10=string_11)
code_block = CodeBlock { "_Ejemplo6"; }
code_block_2 = CodeBlock { "Text"; }
parameter_groups = ParameterGroupUI("PG_VISIBILITY", EnumerationType="Autodesk.Revit.DB.BuiltInParameterGroup, RevitAPI, Version=21.0.0.0, Culture=neutral, PublicKeyToken=null")
boolean = BoolSelector(false)
createProjectParameterForAllCategories = Parameter.CreateProjectParameterForAllCategories(parameterName=list_create, groupName=code_block, type=code_block_2, group=parameter_groups.out1, instance=boolean)
