# Dynamo graph Crear parametros por ejemplar.dyn (Dynamo 2.5.0.7460)

# group: TRAER EL EXCEL
file_path = Filename("C:\Users\JMeruvia\Downloads\PARAMETROS G5.xlsx")
file_from_path = FileObject(path=file_path)

# group: IMPORTAR LA HOJA EXCEL
code_block = CodeBlock { "TEXTOS"; }
importExcel = Data.ImportExcel(file=file_from_path, sheetName=code_block)

# group: TRANSPUESTA
transpose = List.Transpose(lists=importExcel)
code_block_2 = CodeBlock(X=transpose) { X[0]; }

# group: Datos de parametros
code_block_3 = CodeBlock { "PARAMETROS METRADOS"; }
select_parameter_type = ParameterType("Text")
select_builtin_parameter_group = BuiltInParameterGroup("PG_DATA")
boolean = BoolSelector(true)

createSharedParameterForAllCategories = Parameter.CreateSharedParameterForAllCategories(parameterName=code_block_2, groupName=code_block_3, type=select_parameter_type, group=select_builtin_parameter_group, instance=boolean)

# group: IMPORTAR LA HOJA EXCEL
code_block_4 = CodeBlock { "FACTORES"; }
importExcel_2 = Data.ImportExcel(file=file_from_path, sheetName=code_block_4)

# group: TRANSPUESTA
transpose_2 = List.Transpose(lists=importExcel_2)
code_block_5 = CodeBlock(X=transpose_2) { X[0]; }

# group: Datos de parametros
code_block_6 = CodeBlock { "PARAMETROS METRADOS"; }
select_parameter_type_2 = ParameterType("Text")
select_builtin_parameter_group_2 = BuiltInParameterGroup("PG_TEXT")
boolean_2 = BoolSelector(true)

createSharedParameterForAllCategories_2 = Parameter.CreateSharedParameterForAllCategories(parameterName=code_block_5, groupName=code_block_6, type=select_parameter_type_2, group=select_builtin_parameter_group_2, instance=boolean_2)
