# Dynamo graph metraje columnas.dyn (Dynamo 2.5.0.7460)
# packages: Bakery 2017.1.213

string = StringInput("SCC")
categories = Categories("OST_StructuralColumns")
all_elements_of_category = ElementsOfCategory(Category=categories)
parameters = Element.Parameters(element=all_elements_of_category)
flat_list_to_list_of_strings = Custom[Flat List to List of Strings](parameters)  # package Bakery; using python methods
code_block = CodeBlock { "SCC"; }
contains = String.Contains(str=flat_list_to_list_of_strings, searchFor=code_block)
filterByBoolMask = List.FilterByBoolMask(list=all_elements_of_category, mask=contains)
code_block_2 = CodeBlock { "Partida N° 1"; }
code_block_3 = CodeBlock { "01.03.02.01"; }
setParameterByName = Element.SetParameterByName(element=filterByBoolMask.in, parameterName=code_block_2, value=code_block_3)
setParameterByName_2 = Element.SetParameterByName()  # unwired: element, parameterName, value
