# Dynamo graph Edificio dubai.dyn (Dynamo 2.13.1.3887)

# group: Piso 60
P1 = DoubleSlider(16.57, range=0..100 step 0.1)
E1 = DoubleSlider(15.26, range=0..100 step 0.1)
E2 = DoubleSlider(30, range=0..100 step 0.1)
P2 = DoubleSlider(30.5, range=0..100 step 0.1)
R1 = DoubleSlider(0.4, range=0..100 step 0.1)
R2 = DoubleSlider(0.5, range=0..100 step 0.1)
E3 = DoubleSlider(19.27, range=0..100 step 0.1)
basetriangulo01 = Custom[Basetriangulo01](P1=P1, E1=E1, E2=E2, P2=P2, R1=R1, R2=R2, E3=E3)  # proyecto Dubai
number_slider = DoubleSlider(5, range=0..100 step 0.1)
number_slider_2 = DoubleSlider(40, range=0..100 step 0.1)
code_block = CodeBlock(a=number_slider, b=number_slider_2) { a*b; }
translate = Geometry.Translate(geometry=basetriangulo01, zTranslation=code_block)

E3_2 = DoubleSlider(23.47, range=0..100 step 0.1)

# group: PISO 57
P1_2 = DoubleSlider(22.1, range=0..100 step 0.1)
E1_2 = DoubleSlider(17.59, range=0..100 step 0.1)
E2_2 = DoubleSlider(27.5, range=0..100 step 0.1)
P2_2 = DoubleSlider(29.51, range=0..100 step 0.1)
R1_2 = DoubleSlider(3.96, range=0..100 step 0.1)
R2_2 = DoubleSlider(1.38, range=0..100 step 0.1)
basetriangulo01_2 = Custom[Basetriangulo01](P1=P1_2, E1=E1_2, E2=E2_2, P2=P2_2, R1=R1_2, R2=R2_2, E3=E3_2)
number_slider_3 = DoubleSlider(5, range=0..100 step 0.1)
number_slider_4 = DoubleSlider(32, range=0..100 step 0.1)
code_block_2 = CodeBlock(a=number_slider_3, b=number_slider_4) { a*b; }
translate_2 = Geometry.Translate(geometry=basetriangulo01_2, zTranslation=code_block_2)

list_create = List.Create(item0=translate, item1=translate_2)

# group: Generacion de planos de piso
byLoft = Solid.ByLoft()  # unwired: crossSections
number_slider_5 = DoubleSlider(200, range=0..200 step 0.1)
number_slider_6 = DoubleSlider(5, range=0..100 step 0.1)
code_block_3 = CodeBlock(a=number_slider_5, b=number_slider_6) { 0..a..b; }
byCoordinates = Point.ByCoordinates(z=code_block_3)
byOriginNormal = Plane.ByOriginNormal(origin=byCoordinates)
intersect = Geometry.Intersect(geometry=byLoft, other=byOriginNormal)
number_slider_7 = DoubleSlider(-0.3, range=-1..100 step 0.1)
boolean = BoolSelector(false)
thicken = Surface.Thicken(surface=intersect, thickness=number_slider_7, both_sides=boolean)

# group: datos para el Ndo Personalizado Form to Slab
origin = Point.Origin()
byOriginNormal_2 = Plane.ByOriginNormal(origin=origin)
total_Building_Height = CodeBlock { Total_Building_Height; }  # unwired: Total_Building_Height
level_Heigth = CodeBlock { Level_Heigth; }  # unwired: Level_Heigth
code_block_4 = CodeBlock(Total_Building_Height=total_Building_Height, Level_Heigth=level_Heigth) { 0..Total_Building_Height..Level_Heigth; }
translate_3 = Geometry.Translate(geometry=byOriginNormal_2, zTranslation=code_block_4)
select_Form = CodeBlock { Select_Form; }  # unwired: Select_Form
intersect_2 = Geometry.Intersect(geometry=translate_3, other=select_Form)
slab_Thickness = CodeBlock { Slab_Thickness; }  # unwired: Slab_Thickness
code_block_5 = CodeBlock(Slab_Thinckness=slab_Thickness) { Slab_Thinckness; }
code_block_6 = CodeBlock(a=code_block_5) { a*-1; }
boolean_2 = BoolSelector(false)
thicken_2 = Surface.Thicken(surface=intersect_2, thickness=code_block_6, both_sides=boolean_2)

# group: BASE
P1_3 = DoubleSlider(42.82, range=0..100 step 0.1)
E1_3 = DoubleSlider(39.37, range=0..100 step 0.1)
E2_3 = DoubleSlider(18.68, range=0..100 step 0.1)
P2_3 = DoubleSlider(25.15, range=0..100 step 0.1)
R1_3 = DoubleSlider(1.99, range=0..100 step 0.1)
R2_3 = DoubleSlider(8.97, range=0..100 step 0.1)
E3_3 = DoubleSlider(31.14, range=0..100 step 0.1)
basetriangulo01_3 = Custom[Basetriangulo01](P1=P1_3, E1=E1_3, E2=E2_3, P2=P2_3, R1=R1_3, R2=R2_3, E3=E3_3)
number_slider_8 = DoubleSlider(5, range=0..100 step 0.1)
number_slider_9 = DoubleSlider(0, range=0..100 step 0.1)
code_block_7 = CodeBlock(a=number_slider_8, b=number_slider_9) { a*b; }
translate_4 = Geometry.Translate(geometry=basetriangulo01_3, zTranslation=code_block_7)

E3_4 = DoubleSlider(26.62, range=0..100 step 0.1)

# group: PISO 2
P1_4 = DoubleSlider(28.65, range=0..100 step 0.1)
E1_4 = DoubleSlider(24.08, range=0..100 step 0.1)
E2_4 = DoubleSlider(22, range=0..100 step 0.1)
P2_4 = DoubleSlider(24.77, range=0..100 step 0.1)
R1_4 = DoubleSlider(3, range=0..100 step 0.1)
R2_4 = DoubleSlider(5.09, range=0..100 step 0.1)
basetriangulo01_4 = Custom[Basetriangulo01](P1=P1_4, E1=E1_4, E2=E2_4, P2=P2_4, R1=R1_4, R2=R2_4, E3=E3_4)
number_slider_10 = DoubleSlider(5, range=0..100 step 0.1)
number_slider_11 = DoubleSlider(10, range=0..100 step 0.1)
code_block_8 = CodeBlock(a=number_slider_10, b=number_slider_11) { a*b; }
translate_5 = Geometry.Translate(geometry=basetriangulo01_4, zTranslation=code_block_8)

# group: Piso 17
P1_5 = DoubleSlider(22.97, range=0..100 step 0.1)
E1_5 = DoubleSlider(19.48, range=0..100 step 0.1)
E2_5 = DoubleSlider(20.74, range=0..100 step 0.1)
P2_5 = DoubleSlider(25.11, range=0..100 step 0.1)
R1_5 = DoubleSlider(2.19, range=0..100 step 0.1)
R2_5 = DoubleSlider(5.59, range=0..100 step 0.1)
E3_5 = DoubleSlider(24.51, range=0..100 step 0.1)
basetriangulo01_5 = Custom[Basetriangulo01](P1=P1_5, E1=E1_5, E2=E2_5, P2=P2_5, R1=R1_5, R2=R2_5, E3=E3_5)
number_slider_12 = DoubleSlider(5, range=0..100 step 0.1)
number_slider_13 = DoubleSlider(15, range=0..100 step 0.1)
code_block_9 = CodeBlock(a=number_slider_12, b=number_slider_13) { a*b; }
translate_6 = Geometry.Translate(geometry=basetriangulo01_5, zTranslation=code_block_9)

E3_6 = DoubleSlider(22.79, range=0..100 step 0.1)

# group: PISO 30
P1_6 = DoubleSlider(22, range=0..100 step 0.1)
E1_6 = DoubleSlider(22, range=0..100 step 0.1)
E2_6 = DoubleSlider(20.37, range=0..100 step 0.1)
P2_6 = DoubleSlider(23.67, range=0..100 step 0.1)
R1_6 = DoubleSlider(0.01, range=0..100 step 0.1)
R2_6 = DoubleSlider(3.98, range=0..100 step 0.1)
basetriangulo01_6 = Custom[Basetriangulo01](P1=P1_6, E1=E1_6, E2=E2_6, P2=P2_6, R1=R1_6, R2=R2_6, E3=E3_6)
number_slider_14 = DoubleSlider(5, range=0..100 step 0.1)
number_slider_15 = DoubleSlider(20, range=0..100 step 0.1)
code_block_10 = CodeBlock(a=number_slider_14, b=number_slider_15) { a*b; }

translate_7 = Geometry.Translate(geometry=basetriangulo01_6, zTranslation=code_block_10)
list_create_2 = List.Create(item0=translate_4, item1=translate_5, item2=translate_6, item3=translate_7, item4=translate_2, item5=translate)
byLoft_2 = Solid.ByLoft(crossSections=list_create_2)

# group: Generacion de planos de pisos con Form to Slab (nodo personalizado)
number_slider_16 = DoubleSlider(200, range=0..200 step 0.1)
code_block_11 = CodeBlock(a=number_slider_16) { 200..a; }
number_slider_17 = DoubleSlider(5, range=-0.3..100 step 0.1)
code_block_12 = CodeBlock { 0.3; }
form_to_Slab = Custom[Form_to_Slab](Total_Building_Height=code_block_11, Level_Heigth=number_slider_17, Select_Form=byLoft_2, Slab_Thickness=code_block_12)  # crea intersecciones de geometria con un plano
