# Dynamo custom node Basetriangulo01.dyf (Dynamo 2.13.1.3887)
# category: Revit
# proyecto

E3 = DoubleSlider(31, range=0..100 step 0.1)
number_slider = DoubleSlider(25, range=0..100 step 0.1)
number_slider_2 = DoubleSlider(42, range=0..100 step 0.1)
code_block = CodeBlock { [0,60,120,180,240,300]; }
E3_2 = Input(E3: var[]..[] = 42)
byCylindricalCoordinates = Point.ByCylindricalCoordinates(angle=code_block, radius=E3_2)
code_block_2 = CodeBlock(pt=byCylindricalCoordinates) { pt[0]; pt[1]; pt[2]; pt[3]; pt[4]; pt[5]; }
code_block_3 = CodeBlock { [30,150,270]; }
P2 = Input(P2: var[]..[] = 25)
byCylindricalCoordinates_2 = Point.ByCylindricalCoordinates(angle=code_block_3, radius=P2)
code_block_4 = CodeBlock(pt=byCylindricalCoordinates_2) { pt[0]; pt[1]; pt[2]; }
code_block_5 = CodeBlock { [90,210,330]; }
P1 = Input(P1: var[]..[] = 42)
byCylindricalCoordinates_3 = Point.ByCylindricalCoordinates(angle=code_block_5, radius=P1)
code_block_6 = CodeBlock(pt=byCylindricalCoordinates_3) { pt[0]; pt[1]; pt[2]; }
list_create = List.Create(item0=code_block_2.out0, item1=code_block_4.out0, item2=code_block_2.out1, item3=code_block_6.out0, item4=code_block_2.out2, item5=code_block_4.out1, item6=code_block_2.out3, item7=code_block_6.out1, item8=code_block_2.out4, item9=code_block_4.out2, item10=code_block_2.out5, item11=code_block_6.out2)
byPoints = Polygon.ByPoints(points=list_create)
R1 = Input(R1: var[]..[] = 2)
R2 = Input(R2: var[]..[] = 9)

# group: crear circulo
R2_2 = DoubleSlider(9, range=0..20 step 0.1)
R1_2 = DoubleSlider(2, range=0..20 step 0.1)
byCenterPointRadius = Circle.ByCenterPointRadius(centerPoint=byCylindricalCoordinates_3, radius=R1)
byCenterPointRadius_2 = Circle.ByCenterPointRadius(centerPoint=byCylindricalCoordinates_2, radius=R2)

# group: R1
intersect = Geometry.Intersect(geometry=byPoints, other=byCenterPointRadius)
flatten = List.Flatten(list=intersect)
code_block_7 = CodeBlock(pt=flatten) { pt[0]; pt[1]; pt[2]; pt[3]; pt[4]; pt[5]; }

# group: R2
intersect_2 = Geometry.Intersect(geometry=byPoints, other=byCenterPointRadius_2)
flatten_2 = List.Flatten(list=intersect_2)
code_block_8 = CodeBlock(pt=flatten_2) { pt[0]; pt[1]; pt[2]; pt[3]; pt[4]; pt[5]; }

E2 = Input(E2: var[]..[] = 18)

# group: r2
E2_2 = DoubleSlider(18, range=0..100 step 0.1)
code_block_9 = CodeBlock { [30,150,270]; }
byCylindricalCoordinates_4 = Point.ByCylindricalCoordinates(angle=code_block_9, radius=E2)
code_block_10 = CodeBlock(pt=byCylindricalCoordinates_4) { pt[0]; pt[1]; pt[2]; }

E1 = Input(E1: var[]..[] = 40)

# group: r1
E1_2 = DoubleSlider(40, range=0..100 step 0.1)
code_block_11 = CodeBlock { [90,210,330]; }
byCylindricalCoordinates_5 = Point.ByCylindricalCoordinates(angle=code_block_11, radius=E1)
code_block_12 = CodeBlock(pt=byCylindricalCoordinates_5) { pt[0]; pt[1]; pt[2]; }

# group: ARCs
byThreePoints = Arc.ByThreePoints(firstPoint=code_block_7.out5, secondPoint=code_block_2.out0, thirdPoint=code_block_8.out0)
byThreePoints_2 = Arc.ByThreePoints(firstPoint=code_block_8.out0, secondPoint=code_block_10.out0, thirdPoint=code_block_8.out1)
byThreePoints_3 = Arc.ByThreePoints(firstPoint=code_block_8.out1, secondPoint=code_block_2.out1, thirdPoint=code_block_7.out0)
byThreePoints_4 = Arc.ByThreePoints(firstPoint=code_block_7.out0, secondPoint=code_block_12.out0, thirdPoint=code_block_7.out1)
byThreePoints_5 = Arc.ByThreePoints(firstPoint=code_block_7.out1, secondPoint=code_block_2.out2, thirdPoint=code_block_8.out2)
byThreePoints_6 = Arc.ByThreePoints(firstPoint=code_block_8.out2, secondPoint=code_block_10.out1, thirdPoint=code_block_8.out3)
byThreePoints_7 = Arc.ByThreePoints(firstPoint=code_block_8.out3, secondPoint=code_block_2.out3, thirdPoint=code_block_7.out2)
byThreePoints_8 = Arc.ByThreePoints(firstPoint=code_block_7.out2, secondPoint=code_block_12.out1, thirdPoint=code_block_7.out3)
byThreePoints_9 = Arc.ByThreePoints(firstPoint=code_block_7.out3, secondPoint=code_block_2.out4, thirdPoint=code_block_8.out4)
byThreePoints_10 = Arc.ByThreePoints(firstPoint=code_block_8.out4, secondPoint=code_block_10.out2, thirdPoint=code_block_8.out5)
byThreePoints_11 = Arc.ByThreePoints(firstPoint=code_block_8.out5, secondPoint=code_block_2.out5, thirdPoint=code_block_7.out4)
byThreePoints_12 = Arc.ByThreePoints(firstPoint=code_block_7.out4, secondPoint=code_block_12.out2, thirdPoint=code_block_7.out5)

list_create_2 = List.Create(item0=byThreePoints, item1=byThreePoints_2, item2=byThreePoints_3, item3=byThreePoints_4, item4=byThreePoints_5, item5=byThreePoints_6, item6=byThreePoints_7, item7=byThreePoints_8, item8=byThreePoints_9, item9=byThreePoints_10, item10=byThreePoints_11, item11=byThreePoints_12)
byJoinedCurves = PolyCurve.ByJoinedCurves(curves=list_create_2)
PolyCurve = Output(byJoinedCurves)
