# Dynamo graph Edificio dubai31.dyn (Dynamo 2.13.1.3887)

# group: datos
code_block = CodeBlock { 70; 20; 70; 15.5; 40; 10; 12; }
code_block_2 = CodeBlock { 70; 20; 70; 15.5; 40; 10; 12; }
code_block_3 = CodeBlock { 70; 20; 70; 15.5; 40; 20; 12; }
basetriangulo01 = Custom[Basetriangulo01](P1=code_block_3.out0, P2=code_block_3.out1, E1=code_block_3.out2, E2=code_block_3.out3, E3=code_block_3.out4, R1=code_block_3.out5, R2=code_block_3.out6)

# group: PUNTOSATPARAMETER
code_block_4 = CodeBlock { 70; }
code_block_5 = CodeBlock(n=code_block_4) { 0..1..#n; }
code_block_6 = CodeBlock { 1; }
dropItems = List.DropItems(list=code_block_5, amount=code_block_6)
pointAtParameter = Curve.PointAtParameter(param=dropItems@L1)  # frozen; unwired: curve

# group: LINEA TRANSVERSAL2
n2 = CodeBlock(a=pointAtParameter) { a[6..13]; }  # "2"
n3 = CodeBlock(a=pointAtParameter) { a[14..21]; }  # "3"
reverse = List.Reverse(list=n3)
byStartPointEndPoint = Line.ByStartPointEndPoint(endPoint=reverse)  # unwired: startPoint

explode = Geometry.Explode(geometry=basetriangulo01)
centerPoint = Arc.CenterPoint(arc=explode)

# group: arcos origen
r2 = CodeBlock(a=centerPoint) { a[1]; a[5]; a[9]; }
r1 = CodeBlock(a=centerPoint) { a[3]; a[7]; a[11]; }

explode_2 = Geometry.Explode()  # unwired: geometry

# group: VIGAS
ZAxis = Vector.ZAxis()
code_block_7 = CodeBlock { [3.5,7,10.50,14.50]; }
translate = Geometry.Translate(geometry=explode_2, direction=ZAxis, distance=code_block_7, lacing=CrossProduct)  # frozen
list_create = List.Create(item0=explode_2, item1=translate)
levels = Levels("No levels available.")
structural_framing_types = StructuralFramingTypes("300 x 600mm")
beamByCurve = StructuralFraming.BeamByCurve(curve=list_create, level=levels, structuralFramingType=structural_framing_types)

lastItem = List.LastItem(list=code_block_7)

# group: COLUMNAS BORDE
ZAxis_2 = Vector.ZAxis()
code_block_8 = CodeBlock { -5; }
translate_2 = Geometry.Translate(geometry=pointAtParameter, direction=ZAxis_2, distance=code_block_8, lacing=CrossProduct)
ZAxis_3 = Vector.ZAxis()
code_block_9 = CodeBlock { -1; }
mul = code_block_8 * code_block_9
list_create_2 = List.Create(item0=mul, item1=lastItem)
sum = Math.Sum(values=list_create_2)
byStartPointDirectionLength = Line.ByStartPointDirectionLength(startPoint=translate_2, direction=ZAxis_3, length=sum)
levels_2 = Levels("No levels available.")
structural_column_types = StructuralColumnTypes("300mm")
columnByCurve = StructuralFraming.ColumnByCurve(curve=byStartPointDirectionLength, level=levels_2, structuralColumnType=structural_column_types)

# group: CIMENTACION
family_types = FamilyTypes("M_Encepado-3 pilotes:1800 x 2000 x 900mm")
levels_3 = Levels("No levels available.")
byPointAndLevel = FamilyInstance.ByPointAndLevel(familyType=family_types, point=translate_2, level=levels_3)

# group: COLUMNAS BORDE
ZAxis_4 = Vector.ZAxis()
code_block_10 = CodeBlock { -5; }
translate_3 = Geometry.Translate(geometry=pointAtParameter, direction=ZAxis_4, distance=code_block_10, lacing=CrossProduct)  # frozen
ZAxis_5 = Vector.ZAxis()
code_block_11 = CodeBlock { -1; }
mul_2 = code_block_10 * code_block_11
list_create_3 = List.Create(item0=mul_2, item1=lastItem)
sum_2 = Math.Sum(values=list_create_3)
byStartPointDirectionLength_2 = Line.ByStartPointDirectionLength(startPoint=translate_3, direction=ZAxis_5, length=sum_2)
levels_4 = Levels("No levels available.")
structural_column_types_2 = StructuralColumnTypes("300mm")
columnByCurve_2 = StructuralFraming.ColumnByCurve(curve=byStartPointDirectionLength_2, level=levels_4, structuralColumnType=structural_column_types_2)

# group: LINEA TRANSVERSAL1
n6 = CodeBlock(a=pointAtParameter) { a[30..53]; }  # "6"
n1 = CodeBlock(a=n6) { a[-2..5]; }  # "1"
reverse_2 = List.Reverse(list=n6)
byStartPointEndPoint_2 = Line.ByStartPointEndPoint(startPoint=n1, endPoint=reverse_2)

# group: LINEA TRANSVERSAL3
n5 = CodeBlock { a[30..38]; }  # "5"; unwired: a
n4 = CodeBlock { a[22..29]; }  # "4"; unwired: a
reverse_3 = List.Reverse(list=n4)
byStartPointEndPoint_3 = Line.ByStartPointEndPoint(startPoint=n5, endPoint=reverse_3)

list_create_4 = List.Create(item0=byStartPointEndPoint_2, item1=byStartPointEndPoint, item2=byStartPointEndPoint_3)
code_block_12 = CodeBlock {  }
byCoordinates = Point.ByCoordinates()

# group: EJES
code_block_13 = CodeBlock { [90,210,330]; }
code_block_14 = CodeBlock { P1: var[]..[] = 53; }
byCylindricalCoordinates = Point.ByCylindricalCoordinates(angle=code_block_13, radius=code_block_14)

byStartPointEndPoint_4 = Line.ByStartPointEndPoint(startPoint=byCoordinates, endPoint=byCylindricalCoordinates)
intersect = Geometry.Intersect(geometry=byStartPointEndPoint_4, lacing=CrossProduct)  # unwired: other
flatten = List.Flatten()  # unwired: list
intersect_2 = Geometry.Intersect(other=byStartPointEndPoint, lacing=CrossProduct)  # unwired: geometry
flatten_2 = List.Flatten(list=intersect_2)
intersect_3 = Geometry.Intersect(other=byStartPointEndPoint_2, lacing=CrossProduct)  # unwired: geometry
flatten_3 = List.Flatten(list=intersect_3)
list_create_5 = List.Create(item0=flatten, item1=flatten_2, item2=flatten_3)
ZAxis_6 = Vector.ZAxis()
translate_4 = Geometry.Translate(geometry=list_create_5, direction=ZAxis_6, lacing=CrossProduct)  # unwired: distance

# group: horizontal central eje
transpose = List.Transpose(lists=translate_4, lacing=CrossProduct)

# group: vertical eje
byPoints = PolyCurve.ByPoints(points=translate_4)

# group: COLUMNAS EJE
ZAxis_7 = Vector.ZAxis()
code_block_15 = CodeBlock { -5; }
translate_5 = Geometry.Translate(geometry=list_create_5, direction=ZAxis_7, distance=code_block_15, lacing=CrossProduct)
ZAxis_8 = Vector.ZAxis()
code_block_16 = CodeBlock { -1; }
mul_3 = code_block_15 * code_block_16
list_create_6 = List.Create(item0=mul_3, item1=lastItem)
sum_3 = Math.Sum(values=list_create_6)
byStartPointDirectionLength_3 = Line.ByStartPointDirectionLength(startPoint=translate_5, direction=ZAxis_8, length=sum_3)
levels_5 = Levels("No levels available.")
structural_column_types_3 = StructuralColumnTypes("300mm")
columnByCurve_3 = StructuralFraming.ColumnByCurve(curve=byStartPointDirectionLength_3, level=levels_5, structuralColumnType=structural_column_types_3)

# group: ALT DE LAS CURVAS
num_pisos = IntegerSlider(5, range=1..10 step 1)
altura_piso = DoubleSlider(4, range=0..10 step 0.1)
code_block_17 = CodeBlock(numpisos=num_pisos, altpisos=altura_piso) { 0..#numpisos..altpisos; }
byCoordinates_2 = Point.ByCoordinates(z=code_block_17)

# group: arc ALTURAS CENTRO
list_create_7 = List.Create(item0=r1.out0, item1=r1.out1, item2=r1.out2)
X = Point.X(point=list_create_7)
Y = Point.Y(point=list_create_7)
num_pisos_2 = IntegerSlider(5, range=1..10 step 1)
altura_piso_2 = DoubleSlider(4, range=0..10 step 0.1)
code_block_18 = CodeBlock(numpisos=num_pisos_2, altpisos=altura_piso_2) { 0..#numpisos..altpisos; }
byCoordinates_3 = Point.ByCoordinates(x=X, y=Y, z=code_block_18, lacing=Shortest)

ZAxis_9 = Vector.ZAxis()
ZAxis_10 = Vector.ZAxis()
code_block_19 = CodeBlock(a=explode) { a[3]; a[7]; a[11]; }

# group: ARC 1
length = Curve.Length(curve=code_block_19.out1)
code_block_20 = CodeBlock { 4; }
div = length / code_block_20
ceiling = Math.Ceiling(number=div)
code_block_21 = CodeBlock(n=ceiling) { [0..1..#n]; }
pointAtParameter_2 = Curve.PointAtParameter(curve=code_block_19.out1, param=code_block_21)

radius = Arc.Radius(arc=code_block_19.out1)

# group: ARC 2
length_2 = Curve.Length(curve=code_block_19.out0)
code_block_22 = CodeBlock { 4; }
div_2 = length_2 / code_block_22
ceiling_2 = Math.Ceiling(number=div_2)
code_block_23 = CodeBlock(n=ceiling_2) { [0..1..#n]; }
pointAtParameter_3 = Curve.PointAtParameter(curve=code_block_19.out0, param=code_block_23)

# group: ARC 3
length_3 = Curve.Length(curve=code_block_19.out2)
code_block_24 = CodeBlock { 4; }
div_3 = length_3 / code_block_24
ceiling_3 = Math.Ceiling(number=div_3)
code_block_25 = CodeBlock(n=ceiling_3) { [0..1..#n]; }
pointAtParameter_4 = Curve.PointAtParameter(curve=code_block_19.out2, param=code_block_25)

code_block_26 = CodeBlock { [0,1,2]; [4,5,6]; [8,9,10]; }
getItemAtIndex = List.GetItemAtIndex(list=explode, index=code_block_26.out1)

# group: ARC MAYOR1
length_4 = Curve.Length(curve=getItemAtIndex)
code_block_27 = CodeBlock { 5; }
div_4 = length_4 / code_block_27
ceiling_4 = Math.Ceiling(number=div_4)
code_block_28 = CodeBlock(l=ceiling_4) { l[0]; }
code_block_29 = CodeBlock(n=code_block_28) { [0..1..#n]; }
pointAtParameter_5 = Curve.PointAtParameter(curve=getItemAtIndex, param=code_block_29, lacing=CrossProduct)
flatten_4 = List.Flatten(list=pointAtParameter_5)

getItemAtIndex_2 = List.GetItemAtIndex(list=explode, index=code_block_26.out0)

# group: ARC MAYOR2
length_5 = Curve.Length(curve=getItemAtIndex_2)
code_block_30 = CodeBlock { 5; }
div_5 = length_5 / code_block_30
ceiling_5 = Math.Ceiling(number=div_5)
code_block_31 = CodeBlock(l=ceiling_5) { l[0]; }
code_block_32 = CodeBlock(n=code_block_31) { [0..1..#n]; }
pointAtParameter_6 = Curve.PointAtParameter(curve=getItemAtIndex_2, param=code_block_32, lacing=Longest)
flatten_5 = List.Flatten(list=pointAtParameter_6)

# group: grupo
code_block_33 = CodeBlock { 11; }
chop = List.Chop(list=flatten_5, lengths=code_block_33)

getItemAtIndex_3 = List.GetItemAtIndex(list=explode, index=code_block_26.out2)

# group: ARC MAYOR2
length_6 = Curve.Length(curve=getItemAtIndex_3)
code_block_34 = CodeBlock { 5; }
div_6 = length_6 / code_block_34
ceiling_6 = Math.Ceiling(number=div_6)
code_block_35 = CodeBlock(l=ceiling_6) { l[0]; }
code_block_36 = CodeBlock(n=code_block_35) { [0..1..#n]; }
pointAtParameter_7 = Curve.PointAtParameter(curve=getItemAtIndex_3, param=code_block_36, lacing=CrossProduct)
flatten_6 = List.Flatten(list=pointAtParameter_7)

reverse_4 = List.Reverse(list=flatten_6)

# group: grupo
code_block_37 = CodeBlock { 11; }
chop_2 = List.Chop(list=reverse_4, lengths=code_block_37)

byStartPointEndPoint_5 = Line.ByStartPointEndPoint(startPoint=chop, endPoint=chop_2)
code_block_38 = CodeBlock(a=chop_2) { a[0]; a[1]; }
